# Grasshopper definition gis debug.gh (Grasshopper 0.9.76)
# plug-ins: HS_Toolbox, Heron

pt = ConstructPoint(XCoordinate=Slider(500, range=0..1000), YCoordinate=Slider(1000, range=0..1000), ZCoordinate=0)
pt_2 = ConstructPoint(XCoordinate=Slider(1000, range=0..1000), YCoordinate=Slider(1000, range=0..1000), ZCoordinate=0)
pt_3 = Point([Point(-5070993.111, 1304167.045, 0), Point(5379223.981, 1304167.045, 0)])
merge = Merge(Data1=pt, Data2=pt_2)
pt_4 = Point(pt_3)
xytodd = XYToDecimalDegrees(XyPoint=pt_4)  # -> Latitude, Longitude
number_slider = Slider(10, range=0..10)
item = ListItem(List=pt_4, Index=0, Wrap=True)  # -> Item, Item1
split = TextSplit(Text="39.378196, -105.800077", Separators=",")
split_2 = TextSplit(Text="39.482345, -106.362885", Separators=",")
split_3 = TextSplit(Text="39.191233, -105.963691", Separators=",")
split_4 = TextSplit(Text="39.208796, -106.306548", Separators=",")
item_2 = ListItem(List=split, Index=0, Wrap=True)  # -> Item, Item1
item_3 = ListItem(List=split_2, Index=0, Wrap=True)  # -> Item, Item1
item_4 = ListItem(List=split_3, Index=0, Wrap=True)  # -> Item, Item1
item_5 = ListItem(List=split_4, Index=0, Wrap=True)  # -> Item, Item1
number_slider_2 = Slider(100, range=0..100)
merge_2 = Merge(Data1=graft(item_3.Item), Data2=graft(item_2.Item))
merge_3 = Merge(Data1=graft(item_3.Item1), Data2=graft(item_2.Item1))
merge_4 = Merge(Data1=graft(item_5.Item), Data2=graft(item_4.Item))
merge_5 = Merge(Data1=graft(item_5.Item1), Data2=graft(item_4.Item1))
ddtoxy = DecimalDegreesToXY(Latitude=item_2.Item, Longitude=item_2.Item1)
ddtoxy_2 = DecimalDegreesToXY(Latitude=item_3.Item, Longitude=item_3.Item1)
ddtoxy_3 = DecimalDegreesToXY(Latitude=item_4.Item, Longitude=item_4.Item1)
ddtoxy_4 = DecimalDegreesToXY(Latitude=item_5.Item, Longitude=item_5.Item1)
getelevation = GetElevation_GIS(Latitude=merge_2, Longitude=merge_3, Resolution=number_slider_2)
getelevation_2 = GetElevation_GIS(Latitude=merge_4, Longitude=merge_5, Resolution=Slider(100, range=0..100))
ln = Line(StartPoint=ddtoxy_2, EndPoint=ddtoxy)
ln_2 = Line(StartPoint=ddtoxy_4, EndPoint=ddtoxy_3)
divide = DivideCurve(Curve=ln, Count=expr("x-1", number_slider_2), Kinks=False)  # -> Points, Tangents, Parameters
divide_2 = DivideCurve(Curve=ln_2, Count=expr("x-1", number_slider_2), Kinks=False)  # -> Points, Tangents, Parameters
pdecon = Deconstruct(Point=divide.Points)  # -> XComponent, YComponent, ZComponent
pdecon_2 = Deconstruct(Point=divide_2.Points)  # -> XComponent, YComponent, ZComponent
pt_5 = ConstructPoint(XCoordinate=pdecon.XComponent, YCoordinate=pdecon.YComponent, ZCoordinate=getelevation)
pt_6 = ConstructPoint(XCoordinate=pdecon_2.XComponent, YCoordinate=pdecon_2.YComponent, ZCoordinate=getelevation_2)
merge_6 = Merge(Data1=pt_5, Data2=pt_6)
pdecon_3 = Deconstruct(Point=merge_6)  # -> XComponent, YComponent, ZComponent
sort = SortList(Keys=pdecon_3.ZComponent, ValuesA=merge_6)  # -> Keys, ValuesA
item_6 = ListItem(List=sort.ValuesA, Index=0, Wrap=True)
pline = PolyLine(Vertices=pt_5, Closed=False)
pline_2 = PolyLine(Vertices=pt_6, Closed=False)
loft = Loft(
    Curves=[pline, pline_2],
    Options={Adjust=False, Closed=False, LoftEnds=0, LoftSimp=0, LoftType=0, Rebuild=10, Refit=0.01})
Z = UnitZ(Factor=1)
contour = Contour(Shape=loft, Point=item_6, Direction=Z, Distance=Slider(10, range=0..10))
